# Grasshopper definition Pattern.gh (Grasshopper 1.0.7)

piece1 = Curve(<curve referenced from the Rhino model>)
piece2 = Curve(<curve referenced from the Rhino model>)
piece3 = Curve(<curve referenced from the Rhino model>)
piece4 = Curve(<curve referenced from the Rhino model>)
scale = Slider(0.06, range=0..0.1)
max = Slider(0.3, range=0..1)
position = Point(<point referenced from the Rhino model>)
scale_2 = Slider(0.06, range=0..0.1)
max_2 = Slider(0.32, range=0..1)
position_2 = Point(<point referenced from the Rhino model>)
logo = Curve(<curve referenced from the Rhino model>)
logo_2 = Curve(<curve referenced from the Rhino model>)
scale_3 = Slider(0.15, range=0..0.2)
max_3 = Slider(0.55, range=0..1)
position_3 = Point(<point referenced from the Rhino model>)
scale_4 = Slider(0.02, range=0..0.1)
max_4 = Slider(0.2, range=0..1)
position_4 = Point(<point referenced from the Rhino model>)
cluster = Cluster(G=position, N=Slider(8, range=0..10), M=Slider(6, range=0..10), crv=piece1, scale=scale, max=max)
cluster_2 = Cluster(G=position_2, N=Slider(13, range=0..20), M=Slider(7, range=0..10), crv=logo, scale=scale_2, max=max_2)
cluster_3 = Cluster(G=position_3, N=Slider(5, range=0..10), M=Slider(9, range=0..10), crv=logo_2, scale=scale_3, max=max_3)
cluster_4 = Cluster(G=position_4, N=Slider(6, range=0..10), M=Slider(12, range=0..20), crv=piece4, scale=scale_4, max=max_4)
scale_5 = Slider(0.1, range=0..0.1)
max_5 = Slider(0.4, range=0..1)
position_5 = Point(<point referenced from the Rhino model>)
scale_6 = Slider(0.15, range=0..0.2)
max_6 = Slider(0.6, range=0..1)
position_6 = Point(<point referenced from the Rhino model>)
scale_7 = Slider(0, range=0..0.25)
max_7 = Slider(0.6, range=0..1)
position_7 = Point(<point referenced from the Rhino model>)
logo_3 = Curve(<curve referenced from the Rhino model>)
cluster_5 = Cluster(G=position_5, N=Slider(8, range=0..10), M=Slider(5, range=0..10), crv=piece4, scale=scale_5, max=max_5)
cluster_6 = Cluster(G=position_6, N=Slider(6, range=0..10), M=Slider(8, range=0..10), crv=piece2, scale=scale_6, max=max_6)
cluster_7 = Cluster(G=position_7, N=Slider(4, range=0..10), M=Slider(5, range=0..10), crv=logo_3, scale=scale_7, max=max_7)

# ==== cluster Cluster
G = ClusterInput()
N = ClusterInput()
M = ClusterInput()
crv = ClusterInput()
scale = ClusterInput()
max = ClusterInput()
series = Series(Start=0, Step=1, Count=M)
series_2 = Series(Start=0, Step=1, Count=N)
crv_2 = Curve(crv)
Y = UnitY(Factor=series)
X = UnitX(Factor=series_2)
move = Move(Geometry=G, Motion=X)  # -> graft(Geometry), Transform
move_2 = Move(Geometry=move.Geometry, Motion=Y)  # -> flatten(Geometry), Transform
crv_cp = CurveClosestPoint(Point=move_2.Geometry, Curve=crv_2)  # -> Point, Parameter, Distance
scale_2 = Number(scale)
max_2 = Number(max)
dist = Distance(PointA=move_2.Geometry, PointB=crv_cp.Point)
incurve = PointInCurve(Point=move_2.Geometry, Curve=crv_2)  # -> Relationship, Point
equals = Equality(FirstNumber=incurve.Relationship, SecondNumber=0)  # -> Equality, Inequality
multiplication = Multiplication(A=dist, B=scale_2)
subtraction = Subtraction(A=max_2, B=multiplication)
larger = LargerThan(FirstNumber=subtraction, SecondNumber=0)  # -> LargerThan, OrEqualTo
multiplication_2 = Multiplication(A=subtraction, B=larger.LargerThan)
multiplication_3 = Multiplication(A=equals.Inequality, B=max_2)
multiplication_4 = Multiplication(A=equals.Equality, B=multiplication_2)
addition = Addition(A=multiplication_3, B=multiplication_4)
cir = Circle(Plane=move_2.Geometry, Radius=addition)
C = ClusterOutput(cir)
